# Grasshopper definition Cantilever.gh (Grasshopper 1.0.8)
# Copyright: hrntsm
# plug-ins: Lemur Info, IguanaMesh

brep = Brep(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)
number_slider = Slider(5, range=0..10)
ilineartetraprism = ILinearTetraPrism(
    MinimumSize=number_slider,
    MaximunSize=number_slider,
    CurvatureAdapt=False,
    MinimumElements=6,
    Optimization=0,
    QualityType=2,
    QualityThreshold=0.3,
    Massive_Refinement=False)
debrep = DeconstructBrep(Brep=brep)  # -> Faces, Edges, Vertices
ifillbrep = IFillBrep(Brep=brep, ISettings=ilineartetraprism)  # -> IMesh, Entities, Info
Z = UnitZ(Factor=Slider(100, range=0..100))
item = ListItem(List=debrep.Faces, Index=Slider(3, range=0..5), Wrap=True)
item_2 = ListItem(List=debrep.Faces, Index=Slider(5, range=0..5), Wrap=True)
item_3 = ListItem(List=debrep.Faces, Index=Slider(1, range=0..5), Wrap=True)
lefi = LeMeshFromIMesh(Header="Cantilever", IMesh=ifillbrep.IMesh)  # -> LeMesh, Mesh
vec = VectorXYZ(XComponent=0, YComponent=0, ZComponent=0)  # -> Vector, Length
panel = Panel(lefi.LeMesh)
conbc = ConstructBoundaryCondition(TargetGroupName="Fix", Type=0, Values=vec.Vector, Constraints=[True, True, True])
concon = ConstructContact(Name="CP1", Slave="Load", Master="SGRP1", Algorithm=0, Interaction=1)  # -> ContactPair, ContactControl
conss = ConstructSolverSettings(Method=Slider(12, range=0..12), Precondition=Slider(5, range=0..12), MaxIter=100, Residual=1e-08)
conlemat = ConstructLeMaterial(Name="steel", Density="1", YoungsModulus="205000", PoissonRatio="0.3", TargetEGroup="EGRP1")
congrpsurf = GroupFromSurface(Name="Fix", LeMesh=lefi.LeMesh, Surface=item, GroupType=Slider(0, range=0..2), Tolerance=1e-06)  # -> Group, Geometry
congrpsurf_2 = GroupFromSurface(Name="Load", LeMesh=lefi.LeMesh, Surface=item_2, GroupType=Slider(0, range=0..2), Tolerance=1e-06)  # -> Group, Geometry
point_cloud = PointCloudAttributes(Cloud=congrpsurf_2.Geometry)  # -> Cloud, Locations, Normals, Colours, Extra, Hidden
lng = ListLength(List=point_cloud.Locations)
division = Division(A=Z, B=lng)
conbc_2 = ConstructBoundaryCondition(TargetGroupName="Load", Type=Slider(2, range=0..10), Values=division, Constraints=[True, True, True])
congrpsurf_3 = GroupFromSurface(Name="SGRP1", LeMesh=lefi.LeMesh, Surface=item_3, GroupType=Slider(2, range=0..2), Tolerance=1e-06)  # -> Group, Geometry
grpentire = GroupEntireLeMesh(Name="EGRP1", LeMesh=lefi.LeMesh)
constep = ConstructStep(SubSteps=Slider(5, range=0..10), Convergence=1e-06, MaxIterations=100)
conlecnt = ConstructLeControl(
    SolutionType=Slider(1, range=0..1),
    BoundaryConditions=flatten([conbc, conbc_2]),
    ContactControl=concon.ContactControl,
    Step=constep,
    Solver=conss)
panel_2 = Panel(conlecnt)
conleasm = LeAssembleModel(
    LeMesh=lefi.LeMesh,
    LeGrp=flatten([congrpsurf.Group, grpentire, congrpsurf_2.Group, congrpsurf_3.Group]),
    LeCntMsh=concon.ContactPair,
    LeMat=conlemat,
    LeCnt=conlecnt)
path = FilePath("C:\Users\hiroa\Desktop\lemur_test\")
panel_3 = Panel(conleasm)
leexe = LeExecute(LeAssemble=conleasm, Thread="-1", Process="4", Dir=path, Run=Toggle(True))
